# Dynamo graph test1.dyn (Dynamo 2.12.1.8246)

code_block = CodeBlock { true; "E:\\Temp"; "dyn_ifc"; }
color = CodeBlock { [0, 255, 0]; 1; }
ifc_document_specs = dyn2ifc.IfcFile.IfcDoc.ifc_document_specs()
ifc_units = dyn2ifc.IfcFile.IfcDoc.ifc_units()
initIfcDatabase = dyn2ifc.IfcFile.IfcDoc.InitIfcDatabase(ifc_type=ifc_document_specs.Ifc2x3Coordination, units=ifc_units.Metre)
points = Python(IN[0]=initIfcDatabase)  # IronPython2
# ---------- points.python (15 lines) ----------
# Загрузить стандартную библиотеку Python и библиотеку DesignScript
import sys
import clr
clr.AddReference('ProtoGeometry')
from Autodesk.DesignScript.Geometry import Point as _pnt

out_points = list()
out_properties = list()
for i in range (0,50,5):
	for j in range (0,50,5):
		out_points.append(_pnt.ByCoordinates(i,j,0))
		test_property = list()
		test_property.append(["point_name", "point_" + str(i) + "_" + str(j)])
		out_properties.append(test_property)
OUT = out_points,out_properties
# ----------------------------------------
code_block_2 = CodeBlock(a=points) { a[0]; a[1]; }
as_IfcShapeRepresentation = dyn2ifc.IfcGeometry.as_IfcShapeRepresentation.as_IfcShapeRepresentation(color=color.out0, point=code_block_2.out0, radius=color.out1)
get_IfcFaceBasedSurfaceModel = dyn2ifc.IfcGeometry.as_IfcShapeRepresentation.Get_IfcFaceBasedSurfaceModel(as_IfcShapeRepresentation=as_IfcShapeRepresentation)
ifcProperties = dyn2ifc.IfcProperties.IfcProperties(properties=code_block_2.out1)
properties = dyn2ifc.IfcProperties.properties(ifcProperties=ifcProperties)
ifcObject = dyn2ifc.IfcObject.IfcObject(ifcShapeRepresentation=get_IfcFaceBasedSurfaceModel, properties=properties)
code_block_3 = CodeBlock(a=ifcObject) { a; b = 3; }
saveIfc = dyn2ifc.IfcFile.IfcDoc.SaveIfc(directory_path=code_block.out1, file_name=code_block.out2, Overwrite=code_block.out0, aux_order=code_block_3.b)
